# Grasshopper definition rushhour.gh (Grasshopper 0.9.76)

short_brick = Brep(<brep referenced from the Rhino model>)
short_vec = Vector(Vector(-18.42765499, 0, 0))
short_pt = Point(<point referenced from the Rhino model>)
pt = Point([<point referenced from the Rhino model> x7])
item = ListItem(List=pt, Index=Slider(0, range=0..6), Wrap=True)
orient = OrientDirection(Geometry=short_brick, PointA=short_pt, DirectionA=short_vec, PointB=item, DirectionB=short_vec)  # -> Geometry, Transform
preview = CustomPreview(Geometry=orient.Geometry, Shader=ColourSwatch(SwatchColor=RGB(0, 188, 211)))

short_brick_2 = Brep(<brep referenced from the Rhino model>)
short_vec_2 = Vector(Vector(-18.42765499, 0, 0))
short_pt_2 = Point(<point referenced from the Rhino model>)
pt_2 = Point([<point referenced from the Rhino model> x3])
item_2 = ListItem(List=pt_2, Index=Slider(0, range=0..2), Wrap=True)
orient_2 = OrientDirection(Geometry=short_brick_2, PointA=short_pt_2, DirectionA=short_vec_2, PointB=item_2, DirectionB=short_vec_2)  # -> Geometry, Transform
preview_2 = CustomPreview(Geometry=orient_2.Geometry, Shader=ColourSwatch(SwatchColor=RGB(5, 255, 63)))

long_vec = Vector(Vector(-30.92770407, 0, 0))
long_pt = Point(<point referenced from the Rhino model>)
long_brick = Brep(<brep referenced from the Rhino model>)
pt_3 = Point([<point referenced from the Rhino model> x3])
lon_vector_t = Rotate(Geometry=long_vec, Angle=1.570796327, Plane=PlaneXY(0, 0, 0))  # -> Geometry, Transform
set_up = ListItem(List=pt_3, Index=Slider(0, range=0..2), Wrap=True)
blue_brick = OrientDirection(Geometry=long_brick, PointA=long_pt, DirectionA=long_vec, PointB=set_up, DirectionB=lon_vector_t.Geometry)  # -> Geometry, Transform
preview_3 = CustomPreview(Geometry=blue_brick.Geometry, Shader=ColourSwatch(SwatchColor=RGB(175, 62, 216)))

short_brick_3 = Brep(<brep referenced from the Rhino model>)
short_vec_3 = Vector(Vector(-18.42765499, 0, 0))
short_pt_3 = Point(<point referenced from the Rhino model>)
pt_4 = Point([<point referenced from the Rhino model> x8])
item_3 = ListItem(List=pt_4, Index=Slider(0, range=0..7), Wrap=True)
orient_3 = OrientDirection(Geometry=short_brick_3, PointA=short_pt_3, DirectionA=short_vec_3, PointB=item_3, DirectionB=short_vec_3)  # -> Geometry, Transform
preview_4 = CustomPreview(Geometry=orient_3.Geometry, Shader=ColourSwatch(SwatchColor=RGB(255, 0, 0)))

long_vec_2 = Vector(Vector(-30.92770407, 0, 0))
long_pt_2 = Point(<point referenced from the Rhino model>)
long_brick_2 = Brep(<brep referenced from the Rhino model>)
pt_5 = Point([<point referenced from the Rhino model> x7])
lon_vector_t_2 = Rotate(Geometry=long_vec_2, Angle=1.570796327, Plane=PlaneXY(0, 0, 0))  # -> Geometry, Transform
item_4 = ListItem(List=pt_5, Index=Slider(0, range=0..6), Wrap=True)
yellow_brick = OrientDirection(Geometry=long_brick_2, PointA=long_pt_2, DirectionA=long_vec_2, PointB=item_4, DirectionB=lon_vector_t_2.Geometry)  # -> Geometry, Transform
preview_5 = CustomPreview(Geometry=yellow_brick.Geometry, Shader=ColourSwatch(SwatchColor=RGB(255, 255, 0)))

short_brick_4 = Brep(<brep referenced from the Rhino model>)
short_vec_4 = Vector(Vector(-18.42765499, 0, 0))
pt_6 = Point([<point referenced from the Rhino model> x3])
short_pt_4 = Point(<point referenced from the Rhino model>)
rotate = Rotate(Geometry=short_brick_4, Angle=1.570796327, Plane=short_pt_4)  # -> Geometry, Transform
item_5 = ListItem(List=pt_6, Index=Slider(0, range=0..2), Wrap=True)
orient_4 = OrientDirection(Geometry=rotate.Geometry, PointA=short_pt_4, DirectionA=short_vec_4, PointB=item_5, DirectionB=short_vec_4)  # -> Geometry, Transform
preview_6 = CustomPreview(Geometry=orient_4.Geometry, Shader=ColourSwatch(SwatchColor=RGB(239, 113, 15)))

long_vec_3 = Vector(Vector(-30.92770407, 0, 0))
long_pt_3 = Point(<point referenced from the Rhino model>)
long_brick_3 = Brep(<brep referenced from the Rhino model>)
pt_7 = Point([<point referenced from the Rhino model> x5])
set_up_2 = ListItem(List=pt_7, Index=Slider(0, range=0..4), Wrap=True)
yellow_brick_2 = OrientDirection(Geometry=long_brick_3, PointA=long_pt_3, DirectionA=long_vec_3, PointB=set_up_2, DirectionB=long_vec_3)  # -> Geometry, Transform
preview_7 = CustomPreview(Geometry=yellow_brick_2.Geometry, Shader=ColourSwatch(SwatchColor=RGB(88, 189, 169)))

long_vec_4 = Vector(Vector(-30.92770407, 0, 0))
long_pt_4 = Point(<point referenced from the Rhino model>)
long_brick_4 = Brep(<brep referenced from the Rhino model>)
pt_8 = Point([<point referenced from the Rhino model> x5])
lon_vector_t_3 = Rotate(Geometry=long_vec_4, Angle=1.570796327, Plane=PlaneXY(0, 0, 0))  # -> Geometry, Transform
set_up_3 = ListItem(List=pt_8, Index=Slider(0, range=0..4), Wrap=True)
blue_brick_2 = OrientDirection(Geometry=long_brick_4, PointA=long_pt_4, DirectionA=long_vec_4, PointB=set_up_3, DirectionB=lon_vector_t_3.Geometry)  # -> Geometry, Transform
preview_8 = CustomPreview(Geometry=blue_brick_2.Geometry, Shader=ColourSwatch(SwatchColor=RGB(7, 10, 191)))

slider = Slider(0.552, range=0..1)
slider_2 = Slider(0.128, range=0..1)
slider_3 = Slider(1, range=0..1)
# Definition by Andrew Heumann
# 
# http://heumanndesigntech.wordpress.com
slider_4 = Slider(0, range=0..1)
animation_slider = Slider(0.983, range=0..1)
use_smoothing = BooleanToggle(True)
# Step 6. Control your animation with the Animation slider. If you wish to record an animation with more frames than you recorded, enable "use smoothing."
smoothing = Slider(0, range=0..1)
# Step 1.
# Connect your sliders to the Merge component
merge = Merge(Data1=slider_4, Data2=slider, Data3=slider_2, Data4=slider_3)  # -> graft(Result)

# ---- group: Example Definition
box = CenterBox(Base="-2,0,0", X=slider_4, Y=slider, Z=slider_2)
rotate_2 = Rotate(Geometry=box, Angle=slider_3, Plane="-2,0,0")  # -> Geometry, Transform

# ----
# Step 3. Move your sliders in the desired way
panel = Panel("Step 2. Clear Record")

rec = DataRecorder(merge, DataLimit=-10, RecordData=True)
# Step 4. Right click the "D" input above and choose "internalize data"
# Step 5. Go to the end of the definition and replace your slider inputs with the outputs from the "Bang" component
snip = Snip(
    Data=rec,
    Data_2=rec,
    Data_3=snip.Data,
    D=snip.D,
    Data_4=snip.Data,
    InternalDocument_plugin_version=(0, 9, 76),
    InternalDocument_DocumentHeader_PreviewMeshType=1,
    InternalDocument_DocumentHeader_PreviewNormal=RGBA(150, 0, 0, 100),
    InternalDocument_DocumentHeader_PreviewSelected=RGBA(0, 150, 0, 100),
    InternalDocument_DefinitionProperties_Projection_Zoom=1.25)  # -> D, D_2

lng = ListLength(List=snip.D_2)
subtraction = Subtraction(A=lng, B="1")
X = UnitX(Factor=1)
origin = Origin(Point(0, 0, 0))
multiplication = Multiplication(A=subtraction, B=animation_slider)
line = LineSDL(Start=origin, Direction=X, Length="5")
range = Range(Domain="5", Steps=subtraction)
Y = UnitY(Factor=1)
item_6 = IT(List=snip.D_2, Index=multiplication, Wrap=False)
eval = EvaluateCurve(Curve=line, Parameter=animation_slider)  # -> Point, Tangent, Length
pt_9 = PointXYZ(XComponent=range, YComponent=snip.D_2, ZComponent=0, System=PlaneXY(0, 0, 0))
line_2 = LineSDL(Start=eval.Point, Direction=Y, Length=1)
subtraction_2 = Subtraction(A="1", B=smoothing)
intcrv = Interpolate(Vertices=pt_9, Degree=3, Periodic=False)  # -> Curve, Length, Domain
multiplication_2 = Multiplication(A=subtraction, B=subtraction_2)
reb = Rebuild(Curve=intcrv.Curve, Count=multiplication_2, Tangents=False)
clx = CurveLine(Curve=reb, Line=line_2, First=True)  # -> Points, Params, Count
pcomp = Decompose(Point=clx.Points, System=PlaneXY(0, 0, 0))  # -> XComponent, YComponent, ZComponent
filter = StreamFilter(Gate=use_smoothing, Stream0=item_6, Stream1=pcomp.YComponent)
bang = ExplodeTree(Data=filter)  # -> _0000, _0100, _0200, _0300
