# Grasshopper definition rushhour_movie.gh (Grasshopper 0.9.76)

slider = Slider(0.552, range=0..1)
slider_2 = Slider(0.128, range=0..1)
slider_3 = Slider(1, range=0..1)
# Definition by Andrew Heumann
# 
# http://heumanndesigntech.wordpress.com
slider_4 = Slider(0, range=0..1)
animation_slider = Slider(1, range=0..1)
use_smoothing = BooleanToggle(True)
# Step 6. Control your animation with the Animation slider. If you wish to record an animation with more frames than you recorded, enable "use smoothing."
smoothing = Slider(0.258, range=0..1)

# ---- group: Example Definition
box = CenterBox(Base="-2,0,0", X=slider_4, Y=slider, Z=slider_2)
rotate = Rotate(Geometry=box, Angle=slider_3, Plane="-2,0,0")  # -> Geometry, Transform

# ----
# Step 3. Move your sliders in the desired way
panel = Panel("Step 2. Clear Record")
X = UnitX(Factor=1)
origin = Origin(Point(0, 0, 0))
line = LineSDL(Start=origin, Direction=X, Length="5")
Y = UnitY(Factor=1)
eval = EvaluateCurve(Curve=line, Parameter=animation_slider)  # -> Point, Tangent, Length
line_2 = LineSDL(Start=eval.Point, Direction=Y, Length=1)
subtraction = Subtraction(A="1", B=smoothing)
slider_5 = Slider(0.552, range=0..1)
slider_6 = Slider(0.128, range=0..1)
slider_7 = Slider(1, range=0..1)
# Definition by Andrew Heumann
# 
# http://heumanndesigntech.wordpress.com
slider_8 = Slider(0, range=0..1)
animation_slider_2 = Slider(0.983, range=0..1)
use_smoothing_2 = BooleanToggle(True)
# Step 6. Control your animation with the Animation slider. If you wish to record an animation with more frames than you recorded, enable "use smoothing."
smoothing_2 = Slider(0, range=0..1)
# Step 1.
# Connect your sliders to the Merge component
merge = Merge(Data1=slider_8, Data2=slider_5, Data3=slider_6, Data4=slider_7)  # -> graft(Result)

# ---- group: Example Definition
box_2 = CenterBox(Base="-2,0,0", X=slider_8, Y=slider_5, Z=slider_6)
rotate_2 = Rotate(Geometry=box_2, Angle=slider_7, Plane="-2,0,0")  # -> Geometry, Transform

# ----
# Step 3. Move your sliders in the desired way
panel_2 = Panel("Step 2. Clear Record")

rec = DataRecorder(merge, DataLimit=-10, RecordData=True)
# Step 4. Right click the "D" input above and choose "internalize data"
# Step 5. Go to the end of the definition and replace your slider inputs with the outputs from the "Bang" component
snip = Snip(
    Data=rec,
    Data_2=rec,
    Data_3=snip.Data,
    D=snip.D,
    Data_4=snip.Data,
    InternalDocument_plugin_version=(0, 9, 76),
    InternalDocument_DocumentHeader_PreviewMeshType=1,
    InternalDocument_DocumentHeader_PreviewNormal=RGBA(150, 0, 0, 100),
    InternalDocument_DocumentHeader_PreviewSelected=RGBA(0, 150, 0, 100),
    InternalDocument_DefinitionProperties_Projection_Zoom=1.25)  # -> D, D_2

lng = ListLength(List=snip.D_2)
subtraction_2 = Subtraction(A=lng, B="1")
X_2 = UnitX(Factor=1)
origin_2 = Origin(Point(0, 0, 0))
multiplication = Multiplication(A=subtraction_2, B=animation_slider_2)
line_3 = LineSDL(Start=origin_2, Direction=X_2, Length="5")
range = Range(Domain="5", Steps=subtraction_2)
Y_2 = UnitY(Factor=1)
item = IT(List=snip.D_2, Index=multiplication, Wrap=False)
eval_2 = EvaluateCurve(Curve=line_3, Parameter=animation_slider_2)  # -> Point, Tangent, Length
pt = PointXYZ(XComponent=range, YComponent=snip.D_2, ZComponent=0, System=PlaneXY(0, 0, 0))
line_4 = LineSDL(Start=eval_2.Point, Direction=Y_2, Length=1)
subtraction_3 = Subtraction(A="1", B=smoothing_2)
intcrv = Interpolate(Vertices=pt, Degree=3, Periodic=False)  # -> Curve, Length, Domain
multiplication_2 = Multiplication(A=subtraction_2, B=subtraction_3)
reb = Rebuild(Curve=intcrv.Curve, Count=multiplication_2, Tangents=False)
clx = CurveLine(Curve=reb, Line=line_4, First=True)  # -> Points, Params, Count
pcomp = Decompose(Point=clx.Points, System=PlaneXY(0, 0, 0))  # -> XComponent, YComponent, ZComponent
filter = StreamFilter(Gate=use_smoothing_2, Stream0=item, Stream1=pcomp.YComponent)
bang = ExplodeTree(Data=filter)  # -> _0000, _0100, _0200, _0300

short_brick = Brep(<brep referenced from the Rhino model>)
short_vec = Vector(Vector(-18.42765499, 0, 0))
short_pt = Point(<point referenced from the Rhino model>)
pt_2 = Point([<point referenced from the Rhino model> x8])

short_brick_2 = Brep(<brep referenced from the Rhino model>)
short_vec_2 = Vector(Vector(-18.42765499, 0, 0))
short_pt_2 = Point(<point referenced from the Rhino model>)
pt_3 = Point([<point referenced from the Rhino model> x3])

long_vec = Vector(Vector(-30.92770407, 0, 0))
long_pt = Point(<point referenced from the Rhino model>)
long_brick = Brep(<brep referenced from the Rhino model>)
pt_4 = Point([<point referenced from the Rhino model> x3])
lon_vector_t = Rotate(Geometry=long_vec, Angle=1.570796327, Plane=PlaneXY(0, 0, 0))  # -> Geometry, Transform

short_brick_3 = Brep(<brep referenced from the Rhino model>)
short_vec_3 = Vector(Vector(-18.42765499, 0, 0))
short_pt_3 = Point(<point referenced from the Rhino model>)
pt_5 = Point([<point referenced from the Rhino model> x8])

long_vec_2 = Vector(Vector(-30.92770407, 0, 0))
long_pt_2 = Point(<point referenced from the Rhino model>)
long_brick_2 = Brep(<brep referenced from the Rhino model>)
pt_6 = Point([<point referenced from the Rhino model> x7])
lon_vector_t_2 = Rotate(Geometry=long_vec_2, Angle=1.570796327, Plane=PlaneXY(0, 0, 0))  # -> Geometry, Transform

long_vec_3 = Vector(Vector(-30.92770407, 0, 0))
long_pt_3 = Point(<point referenced from the Rhino model>)
long_brick_3 = Brep(<brep referenced from the Rhino model>)
pt_7 = Point([<point referenced from the Rhino model> x5])
lon_vector_t_3 = Rotate(Geometry=long_vec_3, Angle=1.570796327, Plane=PlaneXY(0, 0, 0))  # -> Geometry, Transform

short_brick_4 = Brep(<brep referenced from the Rhino model>)
short_vec_4 = Vector(Vector(-18.42765499, 0, 0))
pt_8 = Point([<point referenced from the Rhino model> x3])
short_pt_4 = Point(<point referenced from the Rhino model>)
rotate_3 = Rotate(Geometry=short_brick_4, Angle=1.570796327, Plane=short_pt_4)  # -> Geometry, Transform

long_vec_4 = Vector(Vector(-30.92770407, 0, 0))
long_pt_4 = Point(<point referenced from the Rhino model>)
long_brick_4 = Brep(<brep referenced from the Rhino model>)
pt_9 = Point([<point referenced from the Rhino model> x5])

# ----
# Step 1.
# Connect your sliders to the Merge component
merge_2 = Merge(
    Data1=Slider(7, range=0..7),
    Data2=Slider(6, range=0..6),
    Data3=Slider(2, range=0..2),
    Data4=Slider(2, range=0..2),
    Data5=Slider(2, range=0..2),
    Data6=Slider(4, range=0..4),
    Data7=Slider(4, range=0..4),
    Data8=Slider(7, range=0..7))  # -> graft(Result)

rec_2 = DataRecorder(merge_2, DataLimit=-10, RecordData=True)
# Step 4. Right click the "D" input above and choose "internalize data"
# Step 5. Go to the end of the definition and replace your slider inputs with the outputs from the "Bang" component
snip_2 = Snip(
    Data=Tree({0;0}: [1, 2, 3, 4, 5, 6, 7, 7, 7, 7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], {0;1}: [0, 0, 0, 0, 0, 0, 0, 0, 1, 2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], {0;2}: [0, 0, 0, 0, 0, 0, 0, 0, 0, 0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], {0;3}: [0, 0, 0, 0, 0, 0, 0, 0, 0, 0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], {0;4}: [0, 0, 0, 0, 0, 0, 0, 0, 0, 0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], {0;5}: [0, 0, 0, 0, 0, 0, 0, 0, 0, 0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], {0;6}: [0, 0, 0, 0, 0, 0, 0, 0, 0, 0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], {0;7}: [0, 0, 0, 0, 0, 0, 0, 0, 0, 0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]),
    Data_2=Tree({0;0}: [1, 2, 3, 4, 5, 6, 7, 7, 7, 7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], {0;1}: [0, 0, 0, 0, 0, 0, 0, 0, 1, 2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], {0;2}: [0, 0, 0, 0, 0, 0, 0, 0, 0, 0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], {0;3}: [0, 0, 0, 0, 0, 0, 0, 0, 0, 0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], {0;4}: [0, 0, 0, 0, 0, 0, 0, 0, 0, 0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], {0;5}: [0, 0, 0, 0, 0, 0, 0, 0, 0, 0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], {0;6}: [0, 0, 0, 0, 0, 0, 0, 0, 0, 0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], {0;7}: [0, 0, 0, 0, 0, 0, 0, 0, 0, 0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]),
    Data_3=snip.Data,
    D=snip.D,
    Data_4=snip.Data,
    ClusterInput=snip,
    ClusterOutput=snip,
    InternalDocument_plugin_version=(0, 9, 76),
    InternalDocument_DocumentHeader_PreviewMeshType=1,
    InternalDocument_DocumentHeader_PreviewNormal=RGBA(150, 0, 0, 100),
    InternalDocument_DocumentHeader_PreviewSelected=RGBA(0, 150, 0, 100),
    InternalDocument_DefinitionProperties_Projection_Zoom=1.25)  # -> D, D_2

lng_2 = ListLength(List=snip_2.D_2)
subtraction_4 = Subtraction(A=lng_2, B="1")
multiplication_3 = Multiplication(A=subtraction_4, B=animation_slider)
range_2 = Range(Domain="5", Steps=subtraction_4)
item_2 = IT(List=snip_2.D_2, Index=multiplication_3, Wrap=False)
pt_10 = PointXYZ(XComponent=range_2, YComponent=snip_2.D_2, ZComponent=0, System=PlaneXY(0, 0, 0))
intcrv_2 = Interpolate(Vertices=pt_10, Degree=3, Periodic=False)  # -> Curve, Length, Domain
multiplication_4 = Multiplication(A=subtraction_4, B=subtraction)
reb_2 = Rebuild(Curve=intcrv_2.Curve, Count=multiplication_4, Tangents=False)
clx_2 = CurveLine(Curve=reb_2, Line=line_2, First=True)  # -> Points, Params, Count
pcomp_2 = Decompose(Point=clx_2.Points, System=PlaneXY(0, 0, 0))  # -> XComponent, YComponent, ZComponent
filter_2 = StreamFilter(Gate=use_smoothing, Stream0=item_2, Stream1=pcomp_2.YComponent)
bang_2 = ExplodeTree(Data=filter_2)  # -> _0000, _0100, _0200, _0300, _0400, _0500, _0600, _0700

item_3 = ListItem(List=pt_2, Index=bang_2._0000, Wrap=True)
orient = OrientDirection(Geometry=short_brick, PointA=short_pt, DirectionA=short_vec, PointB=item_3, DirectionB=short_vec)  # -> Geometry, Transform
preview = CustomPreview(Geometry=orient.Geometry, Shader=ColourSwatch(SwatchColor=RGB(0, 188, 211)))

set_up = ListItem(List=pt_4, Index=bang_2._0300, Wrap=True)
blue_brick = OrientDirection(Geometry=long_brick, PointA=long_pt, DirectionA=long_vec, PointB=set_up, DirectionB=lon_vector_t.Geometry)  # -> Geometry, Transform
preview_2 = CustomPreview(Geometry=blue_brick.Geometry, Shader=ColourSwatch(SwatchColor=RGB(175, 62, 216)))

item_4 = ListItem(List=pt_8, Index=bang_2._0400, Wrap=True)
orient_2 = OrientDirection(Geometry=rotate_3.Geometry, PointA=short_pt_4, DirectionA=short_vec_4, PointB=item_4, DirectionB=short_vec_4)  # -> Geometry, Transform
preview_3 = CustomPreview(Geometry=orient_2.Geometry, Shader=ColourSwatch(SwatchColor=RGB(239, 113, 15)))

item_5 = ListItem(List=pt_6, Index=bang_2._0100, Wrap=True)
yellow_brick = OrientDirection(Geometry=long_brick_2, PointA=long_pt_2, DirectionA=long_vec_2, PointB=item_5, DirectionB=lon_vector_t_2.Geometry)  # -> Geometry, Transform
preview_4 = CustomPreview(Geometry=yellow_brick.Geometry, Shader=ColourSwatch(SwatchColor=RGB(255, 255, 0)))

item_6 = ListItem(List=pt_3, Index=bang_2._0200, Wrap=True)
orient_3 = OrientDirection(Geometry=short_brick_2, PointA=short_pt_2, DirectionA=short_vec_2, PointB=item_6, DirectionB=short_vec_2)  # -> Geometry, Transform
preview_5 = CustomPreview(Geometry=orient_3.Geometry, Shader=ColourSwatch(SwatchColor=RGB(5, 255, 63)))

set_up_2 = ListItem(List=pt_7, Index=bang_2._0600, Wrap=True)
blue_brick_2 = OrientDirection(Geometry=long_brick_3, PointA=long_pt_3, DirectionA=long_vec_3, PointB=set_up_2, DirectionB=lon_vector_t_3.Geometry)  # -> Geometry, Transform
preview_6 = CustomPreview(Geometry=blue_brick_2.Geometry, Shader=ColourSwatch(SwatchColor=RGB(7, 10, 191)))

set_up_3 = ListItem(List=pt_9, Index=bang_2._0500, Wrap=True)
yellow_brick_2 = OrientDirection(Geometry=long_brick_4, PointA=long_pt_4, DirectionA=long_vec_4, PointB=set_up_3, DirectionB=long_vec_4)  # -> Geometry, Transform
preview_7 = CustomPreview(Geometry=yellow_brick_2.Geometry, Shader=ColourSwatch(SwatchColor=RGB(88, 189, 169)))

item_7 = ListItem(List=pt_5, Index=bang_2._0700, Wrap=True)
orient_4 = OrientDirection(Geometry=short_brick_3, PointA=short_pt_3, DirectionA=short_vec_3, PointB=item_7, DirectionB=short_vec_3)  # -> Geometry, Transform
preview_8 = CustomPreview(Geometry=orient_4.Geometry, Shader=ColourSwatch(SwatchColor=RGB(255, 0, 0)))
